# Dynamo graph BatchIFCExport.dyn (Dynamo 2.3.0.5885)

string = StringInput("X:\nor\oppdrag\Sogndal\519\07\5190774\BIM\Konstruksjon\Revit_Sentralfil")
x_nor_oppdrag_sogndal_519_07 = StringInput("X:\nor\oppdrag\Sogndal\519\07\5190774\BIM\Innsynsmodell")  # "X:\nor\oppdrag\Sogndal\519\07\5190774\BIM\Innsynsmodell"
filsti_for_rvt_filer = Directory("X:\nor\oppdrag\Sogndal\519\07\5190774\BIM")  # graph input
filsti_for_exporterte_ifc = Directory("X:\nor\oppdrag\Sogndal\519\07\5190774\BIM")  # graph input
batchIfcExport = Custom[BatchIfcExport](Directorypath=filsti_for_rvt_filer, OutputFilePath=filsti_for_exporterte_ifc)  # Exportere ifc fra alle revit filler til et givet bibliotek
