# Dynamo custom node BatchIfcExport.dyf (Dynamo 2.3.0.5885)
# category: CaAnd
# Exportere ifc fra alle revit filler til et givet bibliotek
# packages: Genius Loci 2021.2.18, Rhythm 2021.1.1

# group: Filsti
Directorypath = Input(Directorypath: var = []..[])

# group: Finner RVT filer i mappen
directory_from_path = DirectoryObject(path=Directorypath)
code_block = CodeBlock { "*.rvt"; }
inkl_undermappe = BoolSelector(false)
getDirectoryContents = FileSystem.GetDirectoryContents(directory=directory_from_path, searchString=code_block, includeSubdirectories=inkl_undermappe)
flatten = List.Flatten(list=getDirectoryContents.files)

# group: Filplassering for exporten
OutputFilePath = Input(OutputFilePath: var = Directorypath)

# group: Åpner og exportere
ʳʰʸᵗʰᵐ_applications = Rhythm.Revit.Application.Applications.OpenDocumentFile(filePath=flatten)
navn_på_view_for_export = CodeBlock { "IFC EXPORT"; }
view_byname = Custom[View ByName](ViewName=navn_på_view_for_export, lacing=Longest)  # package Genius Loci; Collect views by given name in the active or given document. Based on a Christian Gartland's script.
boolean = BoolSelector(false)
fileName = FileSystem.FileName(path=flatten, withExtension=boolean)
code_block_2 = CodeBlock { "_"; }
length = String.Length(str=fileName)

indexOf = String.IndexOf(str=fileName, searchFor=code_block_2)

# group (continued): Åpner og exportere
sub = length - indexOf
remove = String.Remove(str=fileName, startIndex=indexOf, count=sub)
export_ifc_in_document = Custom[Export IFC in Document](document=ʳʰʸᵗʰᵐ_applications, DirectoryPath=OutputFilePath, view=view_byname, Filename=remove, lacing=Longest)  # package Genius Loci; Export Views to IFC file from document. The Project Origin option works only with Revit 2018 and above. Some other IFC options are embedded inside the python script.
code_block_3 = CodeBlock(wait=export_ifc_in_document, pass=ʳʰʸᵗʰᵐ_applications) { out=[wait,pass]; out[1]; }

# group: Syncer og lukker filerne
boolean_2 = BoolSelector(true)
boolean_3 = BoolSelector(false)
synchronizewithcentral_in = Custom[SynchronizeWithCentral in Document](relinquishBorrowedElements=boolean_2, saveLocalFileBeforeSync=boolean_3, runMe=boolean_2, document=code_block_3.out1, lacing=Longest)  # package Genius Loci; Synchronizes a workshared model with the central model with the choice of the Revit document. Based on a Clockwork node
code_block_4 = CodeBlock(wait=synchronizewithcentral_in.success, pass=synchronizewithcentral_in.Document) { out=[wait,pass]; out[1]; }
boolean_4 = BoolSelector(false)
ʳʰʸᵗʰᵐ_applications_2 = Rhythm.Revit.Application.Applications.CloseDocument(document=code_block_4.out1, save=boolean_4)
result = Output(ʳʰʸᵗʰᵐ_applications_2)

watch = Watch(synchronizewithcentral_in.Document)
watch_2 = Watch(ʳʰʸᵗʰᵐ_applications_2)
watch_3 = Watch(export_ifc_in_document)
watch_4 = Watch(ʳʰʸᵗʰᵐ_applications)
watch_5 = Watch(flatten)
